# Grasshopper definition Astar.gh (Grasshopper 1.0.7)

# ---- group: 网格
number_slider = Slider(100, range=1..100)
panel = Panel("1")
recgrid = Rectangular(Plane=PlaneXY(0, 0, 0), SizeX=panel, SizeY=panel, ExtentX=number_slider, ExtentY=number_slider)  # -> Cells, Points

# ---- group: 随机删减
multiplication = Multiplication(A=number_slider, B=number_slider)
division = Division(A=multiplication, B=Slider(3, range=2..50))
reduce = RandomReduce(List=flatten(recgrid.Cells), Reduction=division, Seed=1)

# ---- group: 网格底色+边框
srf = Surface(reduce)
preview = CustomPreview(Geometry=reduce, Material=ColourSwatch(SwatchColor=RGB(0, 0, 0)))
preview_2 = CustomPreview(Geometry=srf, Material=ColourSwatch(SwatchColor=RGB(255, 255, 255)))

# ---- group: 路径计算
c_script = CSharpScript(Recs=reduce, GridNum=number_slider)  # -> out, A; inputs Recs: list of Rectangle3d, GridNum: Int32
# ---------- c_script: C# usings ----------
using System.Linq;
# ---------- c_script: C# ----------
// create all the grids
List<Grid> grids = new List<Grid>();
foreach (Rectangle3d rec in Recs)
{
    grids.Add(new Grid(rec));
}

// create the gridmap
GridMap gridMap = new GridMap(grids, new int[2] {0, 0}, new int[2] {GridNum - 1, GridNum - 1});

// find the path
List<Grid> path = gridMap.findPath();

// visualize the path with points
List<Point3d> pathpts = GridMap.vizPath(path);

A = pathpts;
# ---------- c_script: C# additional code ----------
// the grid object
public class Grid
{
    // initialize
    // index in gridmap
    public int x;
    public int y;
    // costs
    public int gcost;
    public int hcost;
    public int fcost;
    // coords to draw path
    public double cx;
    public double cy;
    // obstacle
    public bool isObstacle;
    // parent
    public Grid parent;

    // constructor 1: valid grid from recs
    public Grid(Rectangle3d rec)
    {
        Point3d center = rec.Center;
        this.cx = center.X;
        this.cy = center.Y;

        this.gcost = int.MaxValue;
        this.hcost = int.MaxValue;
        this.fcost = int.MaxValue;
        this.isObstacle = false;

        this.parent = null;
    }

    // constructor 2: obstacle grid from xi, yi, cx, cy
    public Grid(int xi, int yi, double cx, double cy)
    {
        this.cx = cx;
        this.cy = cy;
        this.x = xi;
        this.y = yi;

        this.gcost = int.MaxValue;
        this.hcost = int.MaxValue;
        this.fcost = int.MaxValue;
        this.isObstacle = true;

        this.parent = null;
    }
}

// the gridmap object
public class GridMap
{
    // initialize
    public Grid[,] grids;
    public Grid grid_start;
    public Grid grid_end;
    public List<double> xvals;
    public List<double> yvals;
    public int xnum;
    public int ynum;

    public List<Grid> open_grids;
    public List<Grid> close_grids;

    // the 4 directions to try
    public int[,] dirs = new int[4, 2] {{0, 1}, {1, 0}, {0, -1}, {-1, 0}};

    // constructor
    public GridMap(List<Grid> grids, int[] start_id, int[] end_id)
    {
        // find all the unique xvals and yvals
        this.formatGrids(grids);
        // put the grids to their locations by coord
        this.indexGrids(grids);

        // set the start and end grid
        this.grid_start = this.grids[start_id[1], start_id[0]];
        this.grid_end = this.grids[end_id[1], end_id[0]];

        this.grid_start.gcost = 0;
        this.grid_start.hcost = this.hcost(this.grid_start);
        this.grid_start.fcost = this.fcost(this.grid_start);

        // the two list
        this.open_grids = new List<Grid>();
        this.close_grids = new List<Grid>();

        this.open_grids.Add(this.grid_start);
    }

    // find the set of xvals and yvals, and the length of both
    private void formatGrids(List<Grid> grids)
    {
        // find all the unique xvals and yvals
        List<double> xvals = new List<double>();
        List<double> yvals = new List<double>();
        foreach (Grid grid in grids)
        {
            xvals.Add(grid.cx);
            yvals.Add(grid.cy);
        }
        xvals = xvals.Distinct().ToList();
        yvals = yvals.Distinct().ToList();
        xvals.Sort();
        yvals.Sort();

        this.xvals = xvals;
        this.yvals = yvals;
        this.xnum = xvals.Count;
        this.ynum = yvals.Count;
    }

    // put the grids to their locations by coord, and set their x and y
    private void indexGrids(List<Grid> grids)
    {
        this.grids = new Grid[this.ynum, this.xnum];

        // set xi, yi for each grid
        foreach (Grid grid in grids)
        {
            grid.x = this.xvals.IndexOf(grid.cx);
            grid.y = this.yvals.IndexOf(grid.cy);
            this.grids[grid.y, grid.x] = grid;
        }

        // set the obstacles
        for (int icol = 0; icol < this.ynum; icol++)
        {
            for (int irow = 0; irow < this.xnum; irow++)
            {
                if (this.grids[icol, irow] == null)
                {
                    Grid grid = new Grid(irow, icol, this.xvals[irow], this.yvals[icol]);
                    this.grids[icol, irow] = grid;
                }
            }
        }
    }

    // gcost
    private int gcost(Grid grid)
    {
        int gc = 0;
        while (grid.parent != null)
        {
            gc++;
            grid = grid.parent;
        }
        return gc;
    }

    // hcost
    private int hcost(Grid grid)
    {
        return Math.Abs(grid.x - this.grid_end.x) + Math.Abs(grid.y - this.grid_end.y);
    }

    // fcost
    private int fcost(Grid grid)
    {
        return grid.gcost + grid.hcost;
    }

    // key function, find the path
    public List<Grid> findPath()
    {
        // ensure valid start and end
        if (this.grid_start.isObstacle || this.grid_end.isObstacle)
        {
            throw new ArgumentException("Either the start or the end grid is obstacle, no path is found");
        }

        // exucute
        while (this.open_grids.Count > 0)
        {
            Grid grid = this.selLowestCostGrid();
            if (this.isEndGrid(grid))
            {
                // build the path and return
                return this.buildPath(grid);
            }
            // not the end grid
            this.open_grids.Remove(grid);
            this.close_grids.Add(grid);

            // try the 4 directions
            for (int diri = 0; diri < 4; diri++)
            {
                // parse the neighbor grid in the direction
                this.parseNeighbor(grid, grid.x + this.dirs[diri, 0], grid.y + this.dirs[diri, 1]);
            }
        }

        // path not found
        throw new ArgumentException("No path is found from the start grid to the end, delete some obstacles and try again");
    }

    // select the grid with lowest cost from the open set
    private Grid selLowestCostGrid()
    {
        List<Grid> tmpgrids = this.open_grids.OrderBy(g => g.fcost).ToList();
        return tmpgrids[0];
    }

    // check if the grid is end
    private bool isEndGrid(Grid grid)
    {
        return grid == this.grid_end;
    }

    // check if the grid is start
    private bool isStartGrid(Grid grid)
    {
        return grid == this.grid_start;
    }

    // build the path by tracing the parent field from the end to the start
    private List<Grid> buildPath(Grid grid)
    {
        // List<int[]> path = new List<int[]>();
        List<Grid> path = new List<Grid>();
        while (!this.isStartGrid(grid))
        {
            path.Insert(0, grid);
            grid = grid.parent;
        }
        // donnot forget the starting grid
        path.Insert(0, grid);
        return path;
    }

    // parse a neighbor grid
    private void parseNeighbor(Grid parent, int x, int y)
    {
        // out of the bound
        if (x < 0 || y < 0 || x >= this.xnum || y >= this.ynum)
        {
            return;
        }

        Grid grid = this.grids[y, x];
        if (grid.isObstacle)
        {
            return;
        }

        // if the grid is already parsed
        if (this.close_grids.Contains(grid))
        {
            return;
        }

        /*  if the grid is in the open set, aka. parsed before,
            then calculate a new gcost from the parent grid,
            and compare the new gcost with its original one,
            and update if need.
        */
        if (this.open_grids.Contains(grid))
        {

            int tmpgcost = parent.gcost + 1;
            if (tmpgcost < grid.gcost)
            {
                // a shorter path found, update
                grid.parent = parent;
                grid.gcost = tmpgcost;
                grid.hcost = this.hcost(grid);
                grid.fcost = this.fcost(grid);
                return;
            }
            else
            {
                // do noting
                return;
            }
        }

        // if the grid is brand new for both the open and clost sets
        grid.parent = parent;
        grid.gcost = parent.gcost + 1;
        grid.hcost = this.hcost(grid);
        grid.fcost = this.fcost(grid);
        this.open_grids.Add(grid);
        return;
    }

    // test functions
    public string printGrids()
    {
        string res = "";
        for (int icol = 0; icol < this.ynum; icol++)
        {
            for (int irow = 0; irow < this.xnum; irow++)
            {
                Grid grid = this.grids[icol, irow];
                res += grid.x.ToString();
                res += ",";
                res += grid.y.ToString();
                res += ",";
                res += grid.isObstacle.ToString();
                res += " ";
            }
            res += "\n";
        }
        return res;
    }
    
    // visualize the path
    public static List<Point3d> vizPath(List<Grid> path)
    {
        List<Point3d> pathpts = new List<Point3d>();
        foreach (Grid grid in path)
        {
            pathpts.Add(new Point3d(grid.cx, grid.cy, 0));
        }
        return pathpts;
    }
}
# ---------- end c_script ----------
panel_2 = Panel(c_script.out)

# ---- group: 路径网格构建
division_2 = Division(A=panel, B="2")
neg = Negative(Value=division_2)
dom = ConstructDomain(DomainStart=neg, DomainEnd=division_2)
rectangle = Rectangle(Plane=c_script.A, XSize=dom, YSize=dom, Radius=0)  # -> Rectangle, Length

# ---- group: 异步加载路径动画上色
number_slider_2 = Slider(12, range=1..15)
srf_2 = Surface(rectangle.Rectangle)
rgb = ColourRGB(Alpha="255", Red="0", Green="0", Blue="255")
rgb_2 = ColourRGB(Alpha="255", Red="0", Green="255", Blue="96")
c_script_2 = CSharpScript(Grids=srf_2, Speed=Slider(1, range=1..10), Reset=Button(), Start=Toggle(False), No_itv=number_slider_2)  # -> ActiveGrids, InactiveGrids; inputs Grids: list of Surface, Speed: Int32, Reset: Boolean, Start: Boolean, No_itv: Int32
# ---------- c_script_2: C# usings ----------
using System.IO;
using System.Linq;
using System.Data;
using System.Drawing;
using System.Reflection;
using System.Windows.Forms;
using System.Xml;
using System.Xml.Linq;
using System.Runtime.InteropServices;

using Rhino.DocObjects;
using Rhino.Collections;
using GH_IO;
using GH_IO.Serialization;
# ---------- c_script_2: C# ----------
List<Surface> res = new List<Surface>();
List<Surface> inactive = new List<Surface>(Grids);

int maxcount = Grids.Count;
int intervalLength = (int) (maxcount / No_itv);

if (Reset) {
    counter = 0;
    ActiveGrids = res;
}
else if (Start) {
    // update
    counter += Speed;
    GrasshopperDocument.ScheduleSolution(10, ScheduleCallback);

    for (int i = 0; i < intervalLength; i ++)
    {
        res.Add(Grids[(counter + i) % maxcount]);
        inactive.Remove(Grids[(counter + i) % maxcount]);
    }
}

ActiveGrids = res;
InactiveGrids = inactive;
# ---------- c_script_2: C# additional code ----------
public int counter = 0;
public void ScheduleCallback(GH_Document document)
{
Component.ExpireSolution(false);
}
# ---------- end c_script_2 ----------
c_script_3 = CSharpScript(Grids=srf_2, No_itv=number_slider_2, C_start=rgb_2, C_end=rgb)  # -> Colors; inputs Grids: list of Surface, No_itv: Int32, C_start: Color, C_end: Color
# ---------- c_script_3: C# usings ----------
using System.Drawing;
# ---------- c_script_3: C# ----------
int eR = C_end.R;
int eG = C_end.G;
int eB = C_end.B;
int sR = C_start.R;
int sG = C_start.G;
int sB = C_start.B;
int dR = eR - sR;
int dG = eG - sG;
int dB = eB - sB;

int intervalLength = (int) (Grids.Count / 12);
double interv = (double)1 / intervalLength;

List<Color> colors = new List<Color>();
for (int i = 0; i < intervalLength; i++)
{
    double factor = 1 - i * interv;
    colors.Add(Color.FromArgb(sR + (int) (dR * factor), sG + (int) (dG * factor), sB + (int) (dB * factor)));
}
Colors = colors;
# ---------- end c_script_3 ----------

# ---- group: 静态路径底色
preview_3 = CustomPreview(Geometry=c_script_2.InactiveGrids, Material=ColourSwatch(SwatchColor=RGB(255, 0, 36)))

# ---- group: 所有路径边框
preview_4 = CustomPreview(Geometry=rectangle.Rectangle, Material=ColourSwatch(SwatchColor=RGB(0, 0, 0)))

# ---- group: 动态路径底色
preview_5 = CustomPreview(Geometry=simplify(graft(c_script_2.ActiveGrids)), Material=simplify(graft(c_script_3)))
